# Grasshopper definition truss_set.gh (Grasshopper 0.9.76)
# plug-ins: Python Interpreter

python = PythonScript(x=Slider(12, range=0..40), y=Slider(2, range=0..10), z=Slider(1.46, range=0..10), segments=Slider(5, range=0..10))  # -> out, a, b, c
# ---------- python: Python ----------
import rhinoscriptsyntax as rs
import Rhino as rc

i = 0
listLine = []
for i in range(4):
    line = rs.AddLine((0,y,0),(x,y,0))
    listLine.append(line)
    i += 2

a = listLine[0]

#divide linha
i = 0
listDivide = []
for i in range(4):
    divide = rs.DivideCurve(listLine[i], segments, create_points=False, return_points=True)
    listDivide.append(divide)
    i += 1

point = listDivide[1]
b = point[1]

#move pontos
i = 0
listMove = []
for i in range(4):
    myVector = rc.Geometry.Vector3d(0,0,z)
    move = b + myVector #b (pq listDivide devolve uma lista, precisa escolher uma linha e depois escolher um ponto dessa linha, seguir..)
    listMove.append(move)

c = listMove
# ---------- end python ----------
line = Line(python.a)
pt = Point(python.b)
